# Grasshopper definition 197_parametric_grasshopper.gh (Grasshopper 0.9.75)

cir = Circle(Plane=PlaneXY(0, 0, 0), Radius=Slider(15, range=0..100))
divide = DivideCurve(Curve=cir, Count=Slider(6, range=0..10), Kinks=False)  # -> Points, Tangents, Parameters
area = Area(Geometry=cir)  # -> Area, Centroid
ln = Line(StartPoint=area.Centroid, EndPoint=divide.Points)
curvepoint = PointOnCurve(ln, parameter=0.5)
number_slider = Slider(1.2, range=0..10)
ln_2 = Line(StartPoint=curvepoint, EndPoint=divide.Points)
neg = Negative(Value=number_slider)
ext = ExtendCurve(Curve=ln_2, Type=0, Start=Slider(0, range=0..100), End=Slider(3, range=0..10))
srf = Surface(cir)
offset = Offset(Curve=ext, Distance=graft(number_slider), Plane=PlaneXY(0, 0, 0), Corners=1)
offset_2 = Offset(Curve=ext, Distance=graft(neg), Plane=PlaneXY(0, 0, 0), Corners=1)
end = EndPoints(Curve=offset_2)  # -> Start, End
end_2 = EndPoints(Curve=offset)  # -> Start, End
ln_3 = Line(StartPoint=end_2.Start, EndPoint=end.Start)
join = JoinCurves(Curves=[ln_3, offset, offset_2], Preserve=False)  # -> flatten(Curves)
srfsplit = SurfaceSplit(Surface=srf, Curves=join)  # -> flatten(Fragments)
area_2 = Area(Geometry=srfsplit)  # -> Area, Centroid
sort = SortList(Keys=area_2.Area, ValuesA=srfsplit)  # -> Keys, reverse(ValuesA)
item = ListItem(List=sort.ValuesA, Index=0, Wrap=True)
crv = Curve(item)
